# Grasshopper definition Import_Edges_P5_to_Rhino_via_Grasshopper.gh (Grasshopper 1.0.7)
# plug-ins: jSwan

digit_scroller = DigitScroller(Scroller_Digits=12, Scroller_Prefix="scale", Scroller_Radix=9, Scroller_Value=1)
digit_scroller_2 = DigitScroller(Scroller_Digits=12, Scroller_Prefix="translateX", Scroller_Radix=9, Scroller_Value=-326)
translatey = DigitScroller(Scroller_Digits=12, Scroller_Prefix="translateY", Scroller_Radix=9, Scroller_Value=0)
translatez = DigitScroller(Scroller_Digits=12, Scroller_Prefix="translateZ", Scroller_Radix=9, Scroller_Value=558)
dejson = DeserializeJson(OutputsLocked=False)
python = GhPythonScript(scale=digit_scroller, translateX=digit_scroller_2, translateY=translatey, translateZ=translatez)  # -> out, technology, methodology, process, knwFramework, other
# ---------- python: Python ----------
"""Provides a scripting component.
    Inputs:
        x: The x script variable
        y: The y script variable
    Output:
        a: The a output variable
        b: another ouput variable"""

__author__ = "jsal"

import rhinoscriptsyntax as rs
import Rhino.Geometry as rg
import Rhino.Collections as rc
import json
import math

print "Instructions: "

#prompt the user for a file to import
filter = "JSON file (*.json)|*.json|All Files (*.*)|*.*||"
filename = rs.OpenFileName("Open JSON File", filter)

print "File name: " + filename
#Read JSON data into the datastore variable
if filename:
    with open(filename, 'r') as f:
        edges = json.load(f)

# The collections of beziers and nurbs
# I first create beziers and then nurbs. Apparently I cannot draw beziers directly
beziersTechnology = []
beziersMethodology = []
beziersProcess = []
beziersKnwFramework = []
beziersOther = []

#https://sites.math.washington.edu/~king/coursedir/m308a01/Projects/m308a01-pdf/yip.pdf
matrix = []
matrix.append( [scale, 0, 0, translateX] )
matrix.append( [0, scale, 0, translateY] )
matrix.append( [0, 0, scale, translateZ] )
matrix.append( [0, 0, 0, 1] )


for x in range(0,len(edges)):
    points = rc.Point3dList()
    coords = edges[x]['controlPoints']

    """IMPORTANT 
        Y and Z coordenates are switched to rotate on transfor 2D in 3D
        Y Coordinates increase goind downwards. In Rhino Y increases upwards. As a result
        the coordinate system is fliped. That is the reson why Z coordinates are negative here
    """ 
    # Control points 
    org = rg.Point3d(coords['org'][0],coords['org'][2],-coords['org'][1])
    orgControl = rg.Point3d(coords['orgControl'][0],coords['orgControl'][2],-coords['orgControl'][1])
    endControl = rg.Point3d(coords['endControl'][0],coords['endControl'][2],-coords['endControl'][1])
    end = rg.Point3d(coords['end'][0],coords['end'][2],-coords['end'][1])
    
    #scale each of the bezier points
    #org = org*scale
    #orgControl = orgControl*scale
    #endControl = endControl*scale
    #end = end*scale
    
    #https://developer.rhino3d.com/api/RhinoScriptSyntax/#collapse-TransformObject
    rs.TransformObject(org,matrix)
    rs.TransformObject(orgControl,matrix)
    rs.TransformObject(endControl,matrix)
    rs.TransformObject(end,matrix)
    
    points.Add(org)
    points.Add(orgControl)
    points.Add(endControl)
    points.Add(end)
    
    
    bezier = rg.BezierCurve(points)
    
    if (edges[x]['edge']['kind'] == 'Technology'):
        beziersTechnology.append(bezier)
    elif(edges[x]['edge']['kind'] == 'Methodology'):
        beziersMethodology.append(bezier)
    elif(edges[x]['edge']['kind'] == 'Process'):
        beziersProcess.append(bezier)
    elif(edges[x]['edge']['kind'] == 'Knowledge Framework'):
        beziersKnwFramework.append(bezier)
    else:
        beziersOther.append(rg.BezierCurve(points))

print translateX

# The nurms to be drawn on Rhino's canvas
nurbs = []

for x in range(0,len(beziersTechnology)):
    nurbs.append(beziersTechnology[x].ToNurbsCurve())


 
technology = beziersTechnology
methodology = beziersMethodology
process = beziersProcess
knwFramework = beziersKnwFramework
other = beziersOther
# ---------- end python ----------
panel = Panel(python.out)
tech = GhPythonScript(x=python.technology)  # -> out, a; inputs x: list
# ---------- tech: Python ----------
__author__ = "jsal"

import rhinoscriptsyntax as rs
import Rhino.Geometry as rg
import Rhino.Collections as rc

beziers = x

nurbs = []

for i in range(0,len(beziers)):
    nurbs.append(beziers[i].ToNurbsCurve())
    

a= nurbs
# ---------- end tech ----------
proc = GhPythonScript(x=python.process)  # -> out, a; inputs x: list; same code as tech
meth = GhPythonScript(x=python.methodology)  # -> out, a; inputs x: list; same code as tech
kfwk = GhPythonScript(x=python.knwFramework)  # -> out, a; inputs x: list; same code as tech
other = GhPythonScript(x=python.other)  # -> out, a; inputs x: list; same code as tech
